# Grasshopper definition CopyToClipboard.gh (Grasshopper 1.0.7)
# plug-ins: ScriptParasite

current_folder = CSharpScript()  # -> out, here
# ---------- current_folder: C# usings ----------
using System.IO;
# ---------- current_folder: C# ----------
    GH_Document doc = owner.OnPingDocument();
    string filePath = doc.FilePath;
    string pathOnly = Path.GetDirectoryName(filePath);
    here = pathOnly;
# ---------- end current_folder ----------

c_script = CSharpScript(iCopy=Button(), iText="12355")  # -> out; inputs iCopy: Boolean, iText: String
# ---------- c_script: C# usings ----------
using System.Windows.Forms;
# ---------- c_script: C# ----------
    if (iCopy)
    {
      Clipboard.SetDataObject(iText);
    }
# ---------- end c_script ----------
scriptpar = ScriptParasite(Enable=Toggle(True), Folder=current_folder.here)
