# Grasshopper definition GetCurrentFolder.gh (Grasshopper 1.0.7)

current_folder = CSharpScript()  # -> out, here
# ---------- current_folder: C# usings ----------
using System.IO;
# ---------- current_folder: C# ----------
    GH_Document doc = owner.OnPingDocument();
    string filePath = doc.FilePath;
    string pathOnly = Path.GetDirectoryName(filePath);
    here = pathOnly;
# ---------- end current_folder ----------
panel = Panel(current_folder.here)
