# Grasshopper definition framing-distribution-study.gh (Grasshopper 1.0.7)
# plug-ins: Build Systems, eleFront

panel = Panel("""TD-tr-HM-A
TD-tr-HM-B
TD-tr-HM-C
TD-tr-HT-A
TD-tr-HT-B
TD-tr-HBV-A
TD-tr-HBV-B
TD-tr-STB-A
DD-tr-HM-A
DD-tr-HM-B
DD-tr-HM-C
DD-tr-HT-A
DD-tr-HT-B
DD-tr-STB-A
DD-tr-STB-B
TW-tr-HM-A
TW-tr-HM-B
TW-tr-HM-C
TW-tr-HM-D
TW-tr-HAT-A
TW-tr-HAT-B
TW-tr-HAT-C
TW-tr-STB
TW-tr-MWZ-A
TW-tr-MWZ-B
TW-tr-MWKS-A
TW-tr-MWKS-B
TW-nt-LB-A
TW-nt-LB-B
IW-tr-HM-A
IW-nt-HT-A
IW-nt-HT-B
IW-tr-STB
IW-nt-MWZ-A
IW-tr-MWKS-A
IW-tr-MWKS-B
IW-nt-MWKS-C
IW-nt-LB-A
IW-nt-LB-B
AW-tr-HM-A
AW-tr-HM-B
AW-tr-HM-C
AW-tr-HM-D
AW-tr-HM-E
AW-nt-TF-A
AW-tr-TF-B
AW-tr-TF-C
AW-tr-TF-D
AW-tr-TF-E
AW-tr-STB-A
AW-tr-STB-B
AW-tr-STB-C
AW-tr-STB-D
AW-tr-STB-E
AW-tr-MWZ-A
AW-tr-MWZ-B
AW-tr-MWZ-C
AW-tr-MWKS-A
AW-tr-MWKS-B
AW-tr-MWKS-C
AW-tr-MWKS-D
KW-tr-STB-A
KW-tr-MWZ-A
KW-tr-MWKS-A
BP-tr-STB-A""")
panel_2 = Panel("930,2  2,44  25,33  -751,15  -60  111,16  1,74  -50,89")
list = ValueList({"Default", "Gipskartonplatte (Feuerschutz)(Dicke 1,25 cm)", "Konstruktionsvollholz (Durchschnitt DE)", "Mineralwolle (Innenausbau-Daemmung)", "Brettsperrholz (Durchschnitt DE)", "Layer 05"}, selected="Gipskartonplatte (Feuerschutz)(Dicke 1,25 cm)")
list_2 = ValueList({"Default", "Gipskartonplatte (Feuerschutz)(Dicke 1,25 cm)", "Konstruktionsvollholz (Durchschnitt DE)", "Mineralwolle (Innenausbau-Daemmung)", "Brettsperrholz (Durchschnitt DE)", "Layer 05"}, selected="Konstruktionsvollholz (Durchschnitt DE)")
list_3 = ValueList({"Default", "Gipskartonplatte (Feuerschutz)(Dicke 1,25 cm)", "Konstruktionsvollholz (Durchschnitt DE)", "Mineralwolle (Innenausbau-Daemmung)", "Brettsperrholz (Durchschnitt DE)", "Layer 05"}, selected="Mineralwolle (Innenausbau-Daemmung)")
list_4 = ValueList({"Default", "Gipskartonplatte (Feuerschutz)(Dicke 1,25 cm)", "Konstruktionsvollholz (Durchschnitt DE)", "Mineralwolle (Innenausbau-Daemmung)", "Brettsperrholz (Durchschnitt DE)", "Layer 05"}, selected="Brettsperrholz (Durchschnitt DE)")
item = ListItem(List=panel, Index=Slider(42, range=0..64), Wrap=True)
panel_3 = Panel(item)
reflay = ReferenceByLayer(LayerName=list, lightweight=False)
reflay_2 = ReferenceByLayer(LayerName=list_2, lightweight=False)
reflay_3 = ReferenceByLayer(LayerName=list_3, lightweight=False)
reflay_4 = ReferenceByLayer(LayerName=list_4, lightweight=False)
bsl = BSComponentsLibrary(
    FolderPath="C:\Users\danie\source\repos\BuildSystems-gh\BuildSystemsGH\bin\Debug\net48\BuildSystems",
    BuildingComponentID=item)
bsl_2 = BSComponentsLibrary(
    FolderPath="C:\Users\danie\source\repos\BuildSystems-gh\BuildSystemsGH\bin\Debug\net48\BuildSystems",
    BuildingComponentID=item)
bsl_3 = BSComponentsLibrary(
    FolderPath="C:\Users\danie\source\repos\BuildSystems-gh\BuildSystemsGH\bin\Debug\net48\BuildSystems",
    BuildingComponentID=item)
bsl_4 = BSComponentsLibrary(
    FolderPath="C:\Users\danie\source\repos\BuildSystems-gh\BuildSystemsGH\bin\Debug\net48\BuildSystems",
    BuildingComponentID=item)
penrt = Panel("""33.49733238
0
2.190268
0""")
gwp = Panel("""1.54129301
0
0.150055
0""")
gwp_2 = Panel("""-721.7380669
809.713196
0
-351.382087""")
penrt_2 = Panel("""1147.436219
48.43363
0
-4702.795686""")
penrt_3 = Panel("""481.1568339
26.302017
5.832409
0""")
gwp_3 = Panel("""40.3054508
0.72123
0.399579
0""")
penrt_4 = Panel("""1876.897174
-21.959702
0
-4682.530042""")
gwp_4 = Panel("""-657.9988452
792.455756
0
-305.989665""")
volume = Volume(Geometry=reflay_4)  # -> Volume, Centroid
volume_2 = Volume(Geometry=reflay)  # -> Volume, Centroid
volume_3 = Volume(Geometry=reflay_2)  # -> Volume, Centroid
volume_4 = Volume(Geometry=reflay_3)  # -> Volume, Centroid
list_5 = ValueList({"A1ToA3", "C3", "C4", "D1", "AToC", "AToD"}, selected="C4")
list_6 = ValueList({"A1ToA3", "C3", "C4", "D1", "AToC", "AToD"}, selected="C3")
list_7 = ValueList({"A1ToA3", "C3", "C4", "D1", "AToC", "AToD"}, selected="D1")
list_8 = ValueList({"A1ToA3", "C3", "C4", "D1", "AToC", "AToD"}, selected="A1ToA3")
srf = Surface(<surface referenced from the Rhino model>)
srf_2 = Surface(<surface referenced from the Rhino model>)
srf_3 = Surface(<surface referenced from the Rhino model>)
srf_4 = Surface(<surface referenced from the Rhino model>)
ma = MassAddition(Input=volume.Volume)  # -> Result, PartialResults
multiplication = Multiplication(A=penrt, B="80")
multiplication_2 = Multiplication(A=gwp, B="80")
ma_2 = MassAddition(Input=volume_2.Volume)  # -> Result, PartialResults
ma_3 = MassAddition(Input=volume_3.Volume)  # -> Result, PartialResults
ma_4 = MassAddition(Input=volume_4.Volume)  # -> Result, PartialResults
multiplication_3 = Multiplication(A=penrt_4, B=ma.Result)
multiplication_4 = Multiplication(A=gwp_4, B=ma.Result)
ac = AssembleComponent(
    FolderPath="C:\Users\danie\source\repos\BuildSystems-gh\BuildSystemsGH\bin\Debug\net48\BuildSystems",
    BuildingSurfaces=<geometry referenced from the Rhino model>,
    ComponentLayersTree=bsl_2,
    CalculationPhase=list_5)  # -> MaterialsAsBoxes, SelectedPhasePENRT, SelectedPhaseGWP
multiplication_5 = Multiplication(A=multiplication, B=ma_2.Result)
ac_2 = AssembleComponent(
    FolderPath="C:\Users\danie\source\repos\BuildSystems-gh\BuildSystemsGH\bin\Debug\net48\BuildSystems",
    BuildingSurfaces=<geometry referenced from the Rhino model>,
    ComponentLayersTree=bsl_3,
    CalculationPhase=list_6)  # -> MaterialsAsBoxes, SelectedPhasePENRT, SelectedPhaseGWP
multiplication_6 = Multiplication(A=multiplication_2, B=ma_2.Result)
ac_3 = AssembleComponent(
    FolderPath="C:\Users\danie\source\repos\BuildSystems-gh\BuildSystemsGH\bin\Debug\net48\BuildSystems",
    BuildingSurfaces=<geometry referenced from the Rhino model>,
    ComponentLayersTree=bsl_4,
    CalculationPhase=list_7)  # -> MaterialsAsBoxes, SelectedPhasePENRT, SelectedPhaseGWP
ac_4 = AssembleComponent(
    FolderPath="C:\Users\danie\source\repos\BuildSystems-gh\BuildSystemsGH\bin\Debug\net48\BuildSystems",
    BuildingSurfaces=<geometry referenced from the Rhino model>,
    ComponentLayersTree=bsl,
    CalculationPhase=list_8)  # -> MaterialsAsBoxes, SelectedPhasePENRT, SelectedPhaseGWP
multiplication_7 = Multiplication(A=penrt_2, B=ma_3.Result)
multiplication_8 = Multiplication(A=gwp_2, B=ma_3.Result)
multiplication_9 = Multiplication(A=penrt_3, B=ma_4.Result)
multiplication_10 = Multiplication(A=gwp_3, B=ma_4.Result)
ma_5 = MassAddition(Input=multiplication_3)  # -> Result, PartialResults
ma_6 = MassAddition(Input=multiplication_4)  # -> Result, PartialResults
ma_7 = MassAddition(Input=multiplication_5)  # -> Result, PartialResults
ma_8 = MassAddition(Input=multiplication_6)  # -> Result, PartialResults
ma_9 = MassAddition(Input=multiplication_7)  # -> Result, PartialResults
ma_10 = MassAddition(Input=multiplication_8)  # -> Result, PartialResults
ma_11 = MassAddition(Input=multiplication_9)  # -> Result, PartialResults
ma_12 = MassAddition(Input=multiplication_10)  # -> Result, PartialResults
area = Area(Geometry=srf)  # -> Area, Centroid
panel_4 = Panel(area.Area)
area_2 = Area(Geometry=srf_2)  # -> Area, Centroid
panel_5 = Panel(area_2.Area)
area_3 = Area(Geometry=srf_4)  # -> Area, Centroid
area_4 = Area(Geometry=srf_3)  # -> Area, Centroid
panel_6 = Panel(area_4.Area)
panel_7 = Panel(area_3.Area)
ma_13 = MassAddition(Input=flatten(ac.SelectedPhasePENRT))  # -> Result, PartialResults
ma_14 = MassAddition(Input=flatten(ac.SelectedPhaseGWP))  # -> Result, PartialResults
ma_15 = MassAddition(Input=flatten(ac_2.SelectedPhasePENRT))  # -> Result, PartialResults
ma_16 = MassAddition(Input=flatten(ac_2.SelectedPhaseGWP))  # -> Result, PartialResults
ma_17 = MassAddition(Input=flatten(ac_3.SelectedPhasePENRT))  # -> Result, PartialResults
ma_18 = MassAddition(Input=flatten(ac_3.SelectedPhaseGWP))  # -> Result, PartialResults
ma_19 = MassAddition(Input=flatten(ac_4.SelectedPhasePENRT))  # -> Result, PartialResults
ma_20 = MassAddition(Input=flatten(ac_4.SelectedPhaseGWP))  # -> Result, PartialResults
ma_21 = MassAddition(Input=[ma_8.Result, ma_10.Result, ma_12.Result, ma_6.Result])  # -> Result, PartialResults
panel_8 = Panel(ma_21.Result)
division = Division(A=ma_13.Result, B=area.Area)
division_2 = Division(A=ma_14.Result, B=area.Area)
division_3 = Division(A=ma_15.Result, B=area_2.Area)
division_4 = Division(A=ma_16.Result, B=area_2.Area)
division_5 = Division(A=ma_17.Result, B=area_3.Area)
division_6 = Division(A=ma_18.Result, B=area_3.Area)
division_7 = Division(A=ma_19.Result, B=area_4.Area)
division_8 = Division(A=ma_20.Result, B=area_4.Area)
panel_9 = Panel(division)  # "MJ/m2"
kgco2_m2 = Panel(division_2)
panel_10 = Panel(division_3)  # "MJ/m2"
kgco2_m2_2 = Panel(division_4)
panel_11 = Panel(division_7)  # "MJ/m2"
kgco2_m2_3 = Panel(division_8)
panel_12 = Panel(division_5)  # "MJ/m2"
kgco2_m2_4 = Panel(division_6)
rep = ReplaceText(Text=panel_9, Find=".", Replace=",", RecursiveReplace=False)
rep_2 = ReplaceText(Text=kgco2_m2, Find=".", Replace=",", RecursiveReplace=False)
rep_3 = ReplaceText(Text=panel_10, Find=".", Replace=",", RecursiveReplace=False)
rep_4 = ReplaceText(Text=kgco2_m2_2, Find=".", Replace=",", RecursiveReplace=False)
item_2 = ListItem(List=multiplication_4, Index="3", Wrap=True)
rep_5 = ReplaceText(Text=panel_12, Find=".", Replace=",", RecursiveReplace=False)
rep_6 = ReplaceText(Text=kgco2_m2_4, Find=".", Replace=",", RecursiveReplace=False)
item_3 = ListItem(List=multiplication_8, Index="3", Wrap=True)
rep_7 = ReplaceText(Text=panel_11, Find=".", Replace=",", RecursiveReplace=False)
rep_8 = ReplaceText(Text=kgco2_m2_3, Find=".", Replace=",", RecursiveReplace=False)
panel_13 = Panel(rep)  # "MJ/m2"
kgco2_m2_5 = Panel(rep_2)
panel_14 = Panel(rep_3)  # "MJ/m2"
kgco2_m2_6 = Panel(rep_4)
panel_15 = Panel(rep_7)  # "MJ/m2"
kgco2_m2_7 = Panel(rep_8)
panel_16 = Panel(rep_5)  # "MJ/m2"
kgco2_m2_8 = Panel(rep_6)
addition = Addition(A=item_3, B=item_2)
division_9 = Division(A=addition, B="9")
panel_17 = Panel(division_9)
concat = Concatenate(
    FragmentA=panel_15,
    FragmentB=";",
    FragmentC=panel_14,
    FragmentD=";",
    FragmentE=panel_13,
    FragmentF=";",
    FragmentG=panel_16,
    FragmentH=";",
    FragmentI=kgco2_m2_7,
    FragmentJ=";",
    FragmentK=kgco2_m2_6,
    FragmentL=";",
    FragmentM=kgco2_m2_5,
    FragmentN=";",
    FragmentO=kgco2_m2_8)
panel_18 = Panel(concat)
c_script = CSharpScript(iCopy=Button(), iText=concat)  # -> out; inputs iCopy: Boolean, iText: String
# ---------- c_script: C# usings ----------
using System.Windows.Forms;
# ---------- c_script: C# ----------
    if (iCopy)
    {
      Clipboard.SetDataObject(iText);
    }
# ---------- end c_script ----------
